# Grasshopper definition 191108 voronoi 3d.gh (Grasshopper 1.0.4)

pt = ConstructPoint(XCoordinate=Slider(80, range=0..100), YCoordinate=Slider(40, range=0..100), ZCoordinate=Slider(20, range=0..100))
box = Box2Pt(PointA=expr("-0.5*x", pt), PointB=expr("0.5*x", pt), Plane=PlaneXY(0, 0, 0))
pop3d = Populate3D(Region=box, Count=20, Seed=1)
crossref = CrossReference(ListA=pop3d, ListB=pop3d, ListC=pop3d, CrossMode=5)  # -> ListA, ListB, ListC
circle = Circle3Pt(PointA=crossref.ListA, PointB=crossref.ListB, PointC=crossref.ListC)  # -> Circle, Plane, Radius
merge = Merge(Data1=graft(crossref.ListA), Data2=graft(crossref.ListB), Data3=graft(crossref.ListC))
deplane = DeconstructPlane(Plane=circle.Plane)  # -> Origin, XAxis, YAxis, ZAxis
ln = Line(StartPoint=merge, EndPoint=graft(deplane.Origin))
lng = ListLength(List=deplane.Origin)
series = Series(Start=0, Step=1, Count=lng)
crossref_2 = CrossReference(ListA=deplane.Origin, ListB=deplane.Origin, CrossMode=3)  # -> ListA, ListB
crossref_3 = CrossReference(ListA=circle.Radius, ListB=circle.Radius, CrossMode=3)  # -> ListA, ListB
crossref_4 = CrossReference(ListA=series, ListB=series, CrossMode=3)  # -> ListA, ListB
dist = Distance(PointA=crossref_2.ListA, PointB=crossref_2.ListB)
smaller = SmallerThan(FirstNumber=dist, SecondNumber=crossref_3.ListA)  # -> SmallerThan, OrEqualTo
panel = Panel(crossref_4.ListA)
partition = PartitionList(List=smaller.SmallerThan, Size=expr("x-1", lng))
ma = MassAddition(Input=partition)  # -> flatten(Result), PartialResults
sort = SortList(Keys=ma.Result)  # -> Keys, ValuesA
